# Grasshopper definition Creating Multiple Simple Grids.gh (Grasshopper 0.9.76)
# plug-ins: Human UI, Telepathy

# HUMAN UI: Creating Multiple Simple Grids
number_slider = Slider(16, range=2..16)
random_names = Panel("""Big boy
labelhead
oofles
flarfle
ignacious
blah
arby's
yeah
what?
sure
why not
YAY!""")
slider = CreateSlider(Slider=number_slider, ShowBounds=False, showLabel=True, ShowTicks=False, ShowTooltip=False, ShowValLabel=True)
values = ValueListener(Elements=slider, SomeProperty=True)  # -> Values, Indices
panel = Panel("""4
8
19""")
jitter = Jitter(List=random_names, Jitter=0.7, Seed=graft(panel))  # -> Values, Indices

# ---- group: Number of Grids
series = Series(Start=1, Step=1, Count=Slider(20, range=0..100))

# ----
bang = ExplodeTree(Data=jitter.Values)  # -> flatten(Branch0), flatten(Branch1), flatten(Branch2)
long = LongestList(ListA=series, ListB=bang.Branch1, PaddingMode=2)  # -> ListA, ListB
long_2 = LongestList(ListA=series, ListB=bang.Branch2, PaddingMode=2)  # -> ListA, ListB
long_3 = LongestList(ListA=series, ListB=bang.Branch0, PaddingMode=2)  # -> ListA, ListB

# ---- group: Spawn multiple elements
textbox = CreateTextBox(Label=long_2.ListB, UpdateButton=invert(True), showLabel=False)  # -> graft(TextBox)
textbox_2 = CreateTextBox(Label=long.ListB, UpdateButton=invert(True), showLabel=False)  # -> graft(TextBox)
textbox_3 = CreateTextBox(Label=long_3.ListB, UpdateButton=invert(True), showLabel=False)  # -> graft(TextBox)
label = CreateLabel(LabelText=long_2.ListB, LabelSize=12, Justification=0)  # -> graft(Label)
# Create Elements
label_2 = CreateLabel(LabelText=long_3.ListB, LabelSize=12, Justification=0)  # -> graft(Label)
label_3 = CreateLabel(LabelText=long.ListB, LabelSize=12, Justification=0)  # -> graft(Label)

# ---- group: Collect Textboxes
merge = Merge(Data1=textbox_3, Data2=textbox_2, Data3=textbox)

# ---- group: Collect Labels
merge_2 = Merge(Data1=label_2, Data2=label_3, Data3=label)

# ----
# Create Grid Memberships
tstat = TreeStatistics(Tree=merge)  # -> Paths, Length, Count
entwine = Entwine(Branch0X=merge_2, Branch1X=merge, FlattenInputs=False)
# Stretch Textboxes
adjustpos = AdjustElementPositioning(ElementsToAdjust=merge, AbsolutePositioning=False, HorizontalAlignment=3)
series_2 = Series(Start=0, Step=1, Count=tstat.Count)
int = Integer(series_2)
# Create N Grids
dup = DuplicateData(Data=int, Number=2, Order=True)  # -> flatten(Data)
panel_2 = Panel("""3*
4*""")
simplegrid = CreateSimpleGrid(
    UIElements=entwine,
    GridMembership=dup,
    Width=Slider(142, range=0..225),
    RowDefinitions="Auto",
    ColumnDefinitions=panel_2)
viewer = ParamViewer(simplegrid)
dup_2 = DuplicateData(Data="false", Number=expr("20-x", values.Values), Order=True)  # -> flatten(Data)
dup_3 = DuplicateData(Data="true", Number=values.Values, Order=True)  # -> flatten(Data)
expander = CreateExpander(UIElements=graft(simplegrid), Open=True)  # -> flatten(Expander)
merge_3 = Merge(Data1=dup_3, Data2=dup_2)

# ----
# Grid of Grids
partition = PartitionList(List=expander, Size=Slider(2, range=0..10))
simplegrid_2 = CreateSimpleGrid(UIElements=partition, RowDefinitions="Auto", ColumnDefinitions="Auto")

hideshow = HideShowElement(ElementToHideShow=expander, Show=merge_3, Collapse=True, Disable=False)
height_percentage = Slider(0.57, range=0..1)
width_percentage = Slider(1, range=0..1)
window_name = Panel("NBBJ Digital")
taskbar_hidden = BooleanToggle(False)
snap = ValueList({"Off": 0, "On": 1}, selected="On")
# Add to Window
merge_4 = Merge(Data1=slider, Data2=simplegrid_2)
list = ValueList({"Top": 0, "Bottom": 1}, selected="Bottom")
list_2 = ValueList({"Left": 0, "Right": 1}, selected="Left")

cluster = Cluster(G_3=snap, G_2=list_2, G_4=list, G=taskbar_hidden, B=width_percentage, B_2=height_percentage)  # -> s_1, R, R_2

# ---- group: Width (plug in to Launch Window)
data = Data(cluster.R)

# ---- group: Height (plug in to Launch Window)
data_2 = Data(cluster.R_2)

# ---- group: Window Position (plug in to Window Appearance)
# WINDOW
pt = Point(cluster.s_1)

# ----
launchwin = LaunchWindow(Show=Toggle(True), Name=window_name, Width=data, Height=data_2, ChildStatus=1, EnableHorizScroll=False)
data_3 = Data(launchwin)
winprops = SetWindowProperties(Window=launchwin, StartingLocation=pt, ShowTitleBar=True, ScaleFactor=1)

hui_windows = RemoteSender(data_3)
addelems = AddElements(Window=launchwin, Elements=flatten(merge_4), DoVLChecking=True)  # -> AddedElements, ElementNames

# ==== cluster Cluster
toolbarheight = Slider(40, range=0..100)
getscreen = GetScreenDimensions()  # -> Width, Height
G = ClusterInput()
includes_dpi_scaling = Panel([getscreen.Width, getscreen.Height])
subtraction = Subtraction(A=getscreen.Height, B=toolbarheight)
B = ClusterInput()
B_2 = ClusterInput()
filter = StreamFilter(Gate=G, Stream0=subtraction, Stream1=getscreen.Height)
multiplication = Multiplication(A=getscreen.Width, B=B)
multiplication_2 = Multiplication(A=filter, B=B_2)
subtraction_2 = Subtraction(A=getscreen.Width, B=multiplication)
G_2 = ClusterInput()
subtraction_3 = Subtraction(A=filter, B=multiplication_2)
G_3 = ClusterInput()
G_4 = ClusterInput()
filter_2 = StreamFilter(Gate=G_2, Stream0="0", Stream1=subtraction_2)
filter_3 = StreamFilter(Gate=G_4, Stream0="0", Stream1=subtraction_3)
pt = ConstructPoint(XCoordinate=filter_2, YCoordinate=filter_3, ZCoordinate=0)
filter_4 = StreamFilter(Gate=G_3, Stream1=pt)
R = ClusterOutput(multiplication)
R_2 = ClusterOutput(multiplication_2)
s_1 = ClusterOutput(filter_4)
