# Grasshopper definition Introduction to Charts.gh (Grasshopper 0.9.76)
# plug-ins: Human UI

# ----
# Try creating different kinds of charts to see how they display data.
number_slider = Slider(4, range=0..10)
chart_type = ValueList({"Horizontal Cluster Bar Chart": 0, "Vertical Cluster Bar Chart": 1, "Horizontal Stacked Bar Chart": 2, "Vertical Stacked Bar Chart": 3, "Pie Chart": 4}, selected="Horizontal Stacked Bar Chart")
pan = Panel("""Apples
Oranges
Bananas
Blueberries
Pineapples""")
seq = Sequence(Count=number_slider, CharPool="ABCDEFGHIJKLMNOPQRSTUVWXYZ", Format="Shipment {0}")
# The multi-chart object creates different kinds of charts - like stacked column and bar graphs. These are useful for displaying data sets that are "M x N" - where you've got M parallel sets with N matching categories.
data = Integer(Tree({0;0;0}: [516, 43, 688, 123, 302], {0;0;1}: [786, 358, 159, 789, 606], {0;0;2}: [449, 525, 800, 990, 153], {0;0;3}: [315, 835, 271, 799, 919]))

# ----
# Try creating different kinds of charts to see how they display data.
pan_2 = Panel("""342
431
554
123
34""")
pan_3 = Panel("""Apples
Oranges
Bananas
Blueberries
Pineapples""")
# Multi Chart Example
chart_type_2 = ValueList({"Pie Chart": 0, "Horizontal Bar Chart": 1, "Vertical Bar Chart": 2, "Doughnut Chart": 3, "Gauge Chart": 4}, selected="Horizontal Bar Chart")
chart = CreateChart(Data=pan_2, Names=pan_3, Title="Fruit", SubTitle="Quantities", ChartType=chart_type_2)

# ----
# HUMAN UI: Introduction to Charts
# Simple Chart Example (Static Display)
# Set the toggle to the right to "True" to launch the window.
toggle = BooleanToggle(False)

merge = Merge(Data1=chart)
launchwin = LaunchWindow(Show=toggle, Name="Control Window", Width=370, Height=400, ChildStatus=0)
# Note that the data set is input as a data tree - you need M branches of N items each - and you should have M cluster titles and N data labels.
panel = Panel(data)

# ----
# Set the toggle to the right to "True" to launch the window.
toggle_2 = BooleanToggle(False)

addelems = AddElements(Window=launchwin, Elements=flatten(merge))  # -> AddedElements, ElementNames
multichart = CreateMultiChart(Data=data, Names=pan, Title="Fruit", SubTitle="Shipments", ClusterTitle=seq, ChartType=chart_type)
generate_new_data = Button()
launchwin_2 = LaunchWindow(Show=toggle_2, Name="Control Window", Width=Slider(680, range=0..1000), Height=400, ChildStatus=0)
merge_2 = Merge(Data1=multichart)
addelems_2 = AddElements(Window=launchwin_2, Elements=flatten(merge_2))  # -> AddedElements, ElementNames
rec = DataRecorder(generate_new_data, DataLimit=-10, RecordData=True)
ma = MassAddition(Input=rec)  # -> Result, PartialResults
new_data_set = NewDataSet(S=ma.Result, data=data)

# ---- group: Initialize Chart
# Try creating different kinds of charts to see how they display data.
pan_4 = Panel("""342
431
554
123
34""")
pan_5 = Panel("""Apples
Oranges
Bananas
Blueberries
Pineapples""")
chart_type_3 = ValueList({"Pie Chart": 0, "Horizontal Bar Chart": 1, "Vertical Bar Chart": 2, "Doughnut Chart": 3, "Gauge Chart": 4}, selected="Horizontal Bar Chart")
chart_2 = CreateChart(Data=pan_4, Names=pan_5, Title="Fruit", SubTitle="Quantities", ChartType=chart_type_3)

# ----
setmultichart = SetMultiChartContents(ChartToModify=multichart, NewChartValues=new_data_set)

# ----
# Simple Chart Example 2 (Dynamic Display)
# Set the toggle to the right to "True" to launch the window.
toggle_3 = BooleanToggle(False)

merge_3 = Merge(Data1=chart_2)
# Chart Styling
new_values = Button()
launchwin_3 = LaunchWindow(Show=toggle_3, Name="Control Window", Width=370, Height=400, ChildStatus=0)
# Use the "Set Chart Appearance" components to set the color scheme for your categories. You can also toggle the display of the title and legends.
swatch = Red(SwatchColor=RGB(168, 0, 0))
swatch_2 = Red(SwatchColor=RGB(255, 140, 0))
swatch_3 = Red(SwatchColor=RGB(212, 199, 28))
swatch_4 = Red(SwatchColor=RGB(63, 57, 184))
swatch_5 = Red(SwatchColor=RGB(67, 184, 57))
addelems_3 = AddElements(Window=launchwin_3, Elements=flatten(merge_3))  # -> AddedElements, ElementNames
rec_2 = DataRecorder(new_values, DataLimit=-10, RecordData=True)
merge_4 = Merge(Data1=swatch, Data2=swatch_2, Data3=swatch_3, Data4=swatch_4, Data5=swatch_5)
# As long as you're only updating values and not categories, the chart will try to animate its update process, and you don't need to supply any additional information. If you provide new categories or more values, the chart will redraw completely.
lng = ListLength(List=pan_4)
ma_2 = MassAddition(Input=rec_2)  # -> Result, PartialResults
random = Random(Range="400", Number=lng, Seed=ma_2.Result)
chartappearance = ChartAppearance(ChartToModify=multichart, Colors=merge_4, Legend=Toggle(True), Title=Toggle(True))
int = Integer(random)
setchart = SetChartContents(ChartToModify=chart_2, NewChartValues=int)

# ==== cluster NewDataSet
data = ClusterInput()
data_2 = Data(data)
lng = ListLength(List=flatten(data_2))
S = ClusterInput()
random = Random(Range="1000", Number=lng, Seed=S)
int = Integer(random)
unflatten = UnflattenTree(Tree=int, Guide=data_2)
T = ClusterOutput(unflatten)
