# Grasshopper definition Save and Restore State.gh (Grasshopper 0.9.76)
# plug-ins: Human UI, MetaHopper

height = Slider(23, range=0..100)
depth = Slider(23, range=0..100)
width = Slider(23, range=0..100)
resolution = Panel("""Coarse
Normal
Fine""")
# HUMAN UI: Save and Restore State
box = CenterBox(Base=PlaneXY(0, 0, 0), X="50", Y="50", Z="50")
slider = CreateSlider(Slider=[width, height, depth], ShowBounds=False, ShowTicks=False, ShowTooltip=False, ShowValLabel=True)

# ---- group: UI Elements
# Save and Restore State
pulldown = CreatePulldownMenu(ListItems=resolution, SelectedIndex=Slider(1, range=0..1))  # -> flatten(Pulldown)
checkbox = CreateCheckbox(Label="Smooth", StartingValue=False)
checkbox_2 = CreateCheckbox(Label="Wireframe", StartingValue=False)
_3dview = Create3DView(MeshToDisplay=box, MeshColors=RGB(255, 0, 0), ViewWidth=300, ViewHeight=300)
colorpicker = CreateColorPicker(DefaultColor=RGB(255, 171, 171))
label = CreateLabel(LabelText="Color", LabelSize=12, Justification=0)
label_2 = CreateLabel(LabelText="Resolution", LabelSize=12, Justification=0)

# ----
# We need a few UI elements - a textbox where the user can enter new state names; a button to trigger the saving of a state; a pulldown to show the list of saved states; a button to restore the selected state, and a button to clear all saved states.
pan = Panel("Save Configuration")
pan_2 = Panel("""Restore Configuration
Clear Saved Configurations
Update Saved""")
# This example shows how to set up a UI window itself to manage saving and restoring "States" - sets of settings for other UI elements in the window.
pan_3 = Panel("Configuration Name")
button = CreateButton(ButtonName=pan, ButtonStyle=1)
button_2 = CreateButton(ButtonName=pan_2, ButtonStyle=1)
label_3 = CreateLabel(LabelText="Saved Configurations", LabelSize=12, Justification=0)

# ---- group: Create Window
launchwin = LaunchWindow(
    Show=Toggle(True),
    Name="Control Window",
    Width=Slider(466, range=0..1000),
    Height=Slider(684, range=0..1000),
    ChildStatus=0,
    EnableHorizScroll=False)

# ----
textbox = CreateTextBox(Label=pan_3, UpdateButton=invert(True))
pulldown_2 = CreatePulldownMenu(SelectedIndex=0)  # -> flatten(Pulldown)

# ----
# We can use a parameter to gather all the elements we want to pay attention to when saving/restoring states.
elements_to_track_for_save_state = Data([slider, checkbox, checkbox_2, colorpicker, pulldown])

# ---- group: Adjust layout/positioning
stack = CreateStack(UIElements=button_2, Horizontal=True)
stack_2 = CreateStack(UIElements=[label_3, pulldown_2], Horizontal=True)
adjustpos = AdjustElementPositioning(ElementsToAdjust=pulldown_2, AbsolutePositioning=False, Width=Slider(288, range=0..1000))

# ---- group: Positioning and Layout
stack_3 = CreateStack(UIElements=[label_2, pulldown], Horizontal=True)
stack_4 = CreateStack(UIElements=[checkbox_2, checkbox], Horizontal=True)
stack_5 = CreateStack(UIElements=[label, colorpicker], Horizontal=True)
stack_6 = CreateStack(UIElements=[stack_5, stack_3], Horizontal=True)
adjustpos_2 = AdjustElementPositioning(ElementsToAdjust=stack_6, Margin=Slider(10, range=0..10), AbsolutePositioning=False)
adjustpos_3 = AdjustElementPositioning(ElementsToAdjust=[pulldown, colorpicker], AbsolutePositioning=False, Width=Slider(145, range=0..1000))

# ----
item = ListItem(List=button_2, Index=0, Wrap=True)  # -> Item, Item1, Item2
# Note that the textbox's value listener is set to update manually. This keeps us from accidentally triggering state saves when we don't mean to. We use the value of the save state button to trigger the update with the optional third "T" input.
values = ValueListener(Elements=button, SomeProperty=True)  # -> Values, Indices
values_2 = ValueListener(Elements=checkbox, SomeProperty=True)  # -> Values, Indices
values_3 = ValueListener(Elements=checkbox_2, SomeProperty=True)  # -> Values, Indices
values_4 = ValueListener(Elements=pulldown, SomeProperty=True)  # -> Values, Indices
values_5 = ValueListener(Elements=colorpicker, SomeProperty=True)  # -> Values, Indices
values_6 = ValueListener(Elements=textbox, Trigger=values.Values, SomeProperty=False)  # -> Values, Indices
values_7 = ValueListener(Elements=pulldown_2, SomeProperty=True)  # -> Values, Indices
values_8 = ValueListener(Elements=item.Item, SomeProperty=True)  # -> Values, Indices
values_9 = ValueListener(Elements=item.Item1, SomeProperty=True)  # -> Values, Indices
values_10 = ValueListener(Elements=item.Item2, SomeProperty=True)  # -> Values, Indices
enable_smoothing = Boolean(values_2.Values)
enable_wireframe = Boolean(values_3.Values)
resolution_index = Data(values_4.Indices)
display_color = Colour(values_5.Values)

# ----
# This merge collects all the UI elements we need to manage our states, to be added into the window.
merge = Merge(Data1=textbox, Data2=button, Data3=stack_2, Data4=stack)

restore_state_button = Data(values_8.Values)
pulldown_menu_element = Data(pulldown_2)
configuration_name = Data(values_6.Values)
pulldown_menu_value = Text(values_7.Values)
save_state_button = Boolean(values.Values)
clear_saved_states_button = Boolean(values_9.Values)
filter = StreamFilter(Gate=values_10.Values, Stream0=configuration_name, Stream1=pulldown_menu_value)
or = GateOr(A=save_state_button, B=values_10.Values)

saved_states = Panel("Long Narrow Green,Blue Rounded Wireframe,My New Config")
objfromgroup = GetObjectsInGroup()

# ----
# Note that saved states are designed to persist on file save - so if you save a new state, the next time you open the definition, all the saved states from last time should still be available.
# The save states component keeps track of all of our saved states, adding new ones each time "Save" is set to true, and outputting a list of saved states and their names.
savestates = SaveElementStates(
    Elements=flatten(elements_to_track_for_save_state),
    SaveState=or,
    StateName=filter,
    ClearSavedStates=clear_saved_states_button,
    stateSetChunk_State0_stateName="Long Narrow Green",
    stateSetChunk_State0_stateItem0_ElementIndex=0,
    stateSetChunk_State0_stateItem0_ElementValue="25",
    stateSetChunk_State0_stateItem0_ElementValueType="System.Double",
    stateSetChunk_State0_stateItem1_ElementIndex=1,
    stateSetChunk_State0_stateItem1_ElementValue="7",
    stateSetChunk_State0_stateItem1_ElementValueType="System.Double",
    stateSetChunk_State0_stateItem2_ElementIndex=2,
    stateSetChunk_State0_stateItem2_ElementValue="8",
    stateSetChunk_State0_stateItem2_ElementValueType="System.Double",
    stateSetChunk_State0_stateItem3_ElementIndex=0,
    stateSetChunk_State0_stateItem3_ElementValue="False",
    stateSetChunk_State0_stateItem3_ElementValueType="System.Boolean",
    stateSetChunk_State0_stateItem4_ElementIndex=0,
    stateSetChunk_State0_stateItem4_ElementValue="False",
    stateSetChunk_State0_stateItem4_ElementValueType="System.Boolean",
    stateSetChunk_State0_stateItem5_ElementIndex=0,
    stateSetChunk_State0_stateItem5_ElementValue="Color [A=255, R=127, G=255, B=0]",
    stateSetChunk_State0_stateItem5_ElementValueType="System.Drawing.Color",
    stateSetChunk_State0_stateItem6_ElementIndex=0,
    stateSetChunk_State0_stateItem6_ElementValue="Normal",
    stateSetChunk_State0_stateItem6_ElementValueType="System.String",
    stateSetChunk_State1_stateName="Blue Rounded Wireframe",
    stateSetChunk_State1_stateItem0_ElementIndex=0,
    stateSetChunk_State1_stateItem0_ElementValue="16",
    stateSetChunk_State1_stateItem0_ElementValueType="System.Double",
    stateSetChunk_State1_stateItem1_ElementIndex=1,
    stateSetChunk_State1_stateItem1_ElementValue="21",
    stateSetChunk_State1_stateItem1_ElementValueType="System.Double",
    stateSetChunk_State1_stateItem2_ElementIndex=2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)  # -> SavedStates, SavedStateNames

values_11 = ValueListener(Elements=slider, SomeProperty=True)  # -> Values, Indices
join = TextJoin(Text=savestates.SavedStateNames, Join=",")
split = TextSplit(Text=saved_states, Separators=",")

# ----
# Definition Logic
resolution_parameters = Panel("""4
10
16""")
item_2 = ListItem(List=flatten(values_11.Values), Index=0, Wrap=True)  # -> Item, Item1, Item2
item_3 = ListItem(List=resolution_parameters, Index=resolution_index, Wrap=True)
box_2 = CenterBox(Base=PlaneXY(0, 0, 0), X=item_2.Item, Y=item_2.Item1, Z=item_2.Item2)
mbox = MeshBox(Base=box_2, XCount=item_3, YCount=item_3, ZCount=item_3)
gate = StreamGate(Stream=mbox, Gate=enable_smoothing)  # -> Target0, Target1
weld = WeldMesh(Mesh=gate.Target1, Angle=3.141592654)
msmooth = SmoothMesh(Mesh=weld, Strength=Slider(1, range=0..1), SkipNaked=True, Iterations=1)
filter_2 = StreamFilter(Gate=enable_smoothing, Stream0=gate.Target0, Stream1=msmooth)
gate_2 = StreamGate(Stream=filter_2, Gate=enable_wireframe)  # -> Target0, Target1
m_carpet = MCarpet(m=gate_2.Target1, t0=Slider(0.1, range=0..1), t1=0.5)  # -> out, A; inputs m: Mesh, t0: list, t1: list, clr: list of Color
# ---------- m_carpet: VB ----------
    Component.Params.Input(0).Name = "Mesh"
    Component.Params.Input(0).Description = "Open or closed mesh"
    Component.Params.Input(1).Name = "Center Offset (Unitized)"
    Component.Params.Input(1).Description = "A single number or list of numbers corresponding to each vertex of a mesh which sets the new mesh faces distance from the origin face's center point"
    Component.Params.Input(2).Name = "Edge Offset (Unitized) "
    Component.Params.Input(2).Description = "A single number or list of numbers corresponding to each vertex of a mesh which sets the new mesh faces distance from the origin face's vertex to it's corresponding edge midpoint"
    Component.Params.Input(3).Name = "Face Color "
    Component.Params.Input(3).Description = "A an optional color or list of colors corresponding to each face of a mesh which colors the new edge vertices"

    Component.Params.Output(1).Name = "Mesh"
    Component.Params.Output(1).Description = "If successful, a valid mesh"

    If m IsNot Nothing Then
      Dim msh As New Mesh
      Dim pts As Rhino.Geometry.Collections.MeshVertexList
      Dim faces As Rhino.Geometry.Collections.MeshFaceList
      Dim clrs As Rhino.Geometry.Collections.MeshVertexColorList
      Dim clrBool As Boolean
      Dim _clr As color
      Dim face As MeshFace
      Dim i,j,k,r As Integer

      faces = m.Faces
      pts = m.Vertices
      If m.VertexColors.count() = 0 Then m.VertexColors.CreateMonotoneMesh(color.FromArgb(100, 100, 100))
      clrs = m.VertexColors

      Dim ptList As New list(Of point3d)
      Dim fcList As New list(Of MeshFace)
      Dim clrList As New list(Of color)

      If clr.count() > 0 Then clrBool = False Else clrBool = True

      For i = 0 To faces.Count() - 1 Step 1
        If clrBool = False Then If i > (clr.count() - 1) Then _clr = clr.item(clr.count() - 1) Else _clr = clr.item(i)
        Dim _t0, _t1 As New list(Of Double)

        Dim cen As New Point3d
        Dim tPts As New list(Of point3d)
        Dim tclr As New list(Of Color)
        Dim fclr,avgClr As New color
        Dim rV,gV,bV As New Double
        face = faces(i)
        k = ptList.count()

        'Create Point List
        If face.IsQuad Then r = 4 Else r = 3

        If face.IsQuad Then tPts.add(New point3d(pts(face.D))) Else tPts.add(New point3d(pts(face.C)))
        tPts.add(New point3d(pts(face.A)))
        tPts.add(New point3d(pts(face.B)))
        tPts.add(New point3d(pts(face.C)))
        If face.IsQuad Then tPts.add(New point3d(pts(face.D)))
        tPts.add(New point3d(pts(face.A)))

        If face.IsQuad Then tclr.add(clrs(face.D)) Else tclr.add(clrs(face.C))
        tclr.add(clrs(face.A))
        tclr.add(clrs(face.B))
        tclr.add(clrs(face.C))
        If face.IsQuad Then tclr.add(clrs(face.D))
        tclr.add(clrs(face.A))

        If face.IsQuad Then If face.D > (t0.count() - 1) Then _t0.add(t0.item(t0.count() - 1)) Else _t0.add(t0.item(face.D)) Else If face.C > (t0.count() - 1) Then _t0.add(t0.item(t0.count() - 1)) Else _t0.add(t0.item(face.C))
        If face.A > (t0.count() - 1) Then _t0.add(t0.item(t0.count() - 1)) Else _t0.add(t0.item(face.A))
        If face.B > (t0.count() - 1) Then _t0.add(t0.item(t0.count() - 1)) Else _t0.add(t0.item(face.B))
        If face.C > (t0.count() - 1) Then _t0.add(t0.item(t0.count() - 1)) Else _t0.add(t0.item(face.C))
        If face.IsQuad Then If face.D > (t0.count() - 1) Then _t0.add(t0.item(t0.count() - 1)) Else _t0.add(t0.item(face.D))
        If face.A > (t0.count() - 1) Then _t0.add(t0.item(t0.count() - 1)) Else _t0.add(t0.item(face.A))

        If face.IsQuad Then If face.D > (t1.count() - 1) Then _t1.add(t1.item(t1.count() - 1)) Else _t1.add(t1.item(face.D)) Else If face.C > (t1.count() - 1) Then _t1.add(t1.item(t1.count() - 1)) Else _t1.add(t1.item(face.C))
        If face.A > (t1.count() - 1) Then _t1.add(t1.item(t1.count() - 1)) Else _t1.add(t1.item(face.A))
        If face.B > (t1.count() - 1) Then _t1.add(t1.item(t1.count() - 1)) Else _t1.add(t1.item(face.B))
        If face.C > (t1.count() - 1) Then _t1.add(t1.item(t1.count() - 1)) Else _t1.add(t1.item(face.C))
        If face.IsQuad Then If face.D > (t1.count() - 1) Then _t1.add(t1.item(t1.count() - 1)) Else _t1.add(t1.item(face.D))
        If face.A > (t1.count() - 1) Then _t1.add(t1.item(t1.count() - 1)) Else _t1.add(t1.item(face.A))

        'Get the averaged Center Point
        For j = 1 To tPts.count() - 2 Step 1
          cen += tPts.item(j)
          rV += tclr.item(j).r
          gV += tclr.item(j).g
          bV += tclr.item(j).b
        Next

        cen = cen / r
        fclr = color.FromArgb(CInt(rV / r), CInt(gV / r), CInt(bV / r))

        'Create the new Vertex Points
        For j = 1 To tPts.count() - 2 Step 1
          Dim tp0,tp1 As New Double
          tp0 = (_t0.item(j) + _t0.item(j + 1)) / 2
          tp1 = (_t1.item(j) + _t1.item(j + 1)) / 2
          tp1 = (tp0 + (tp0 / 3)) * tp1
          If tp1 > 1 Then tp1 = 1

          ptList.add(tPts.item(j))
          ptList.add(tPts.item(j) + (cen - tPts.item(j)) * _t0.item(j))
          ptList.add(tPts.item(j) + ((tPts.item(j) + tPts.item(j + 1)) / 2 - tPts.item(j)) * tp1)
          ptList.add(tPts.item(j + 1) + ((tPts.item(j) + tPts.item(j + 1)) / 2 - tPts.item(j + 1)) * tp1)

          avgClr = colorAverage(tclr.item(j), tclr.item(j + 1), 0.5)
          clrList.add(tclr.item(j))
          If clrBool = True Then clrList.add(colorAverage(fclr, tclr.item(j), _t0.item(j))) Else clrList.add(_clr)
          clrList.add(colorAverage(tclr.item(j), avgClr, 1 - tp1))
          clrList.add(colorAverage(tclr.item(j + 1), avgClr, 1 - tp1))
        Next

        'Assign the Faces
        r = r * 4
        For j = k To k + r - 5 Step 4

          fcList.add(New MeshFace(j + 1, j + 2, j + 3, j + 5))
          fcList.add(New MeshFace(j + 5, j + 3, j + 4, j + 6))
        Next

        fcList.add(New MeshFace(k + r - 3, k + r - 2, k + r - 1, k + 1))
        fcList.add(New MeshFace(k + 1, k + r - 1, k, k + 2))
      Next

      msh.Vertices.AddVertices(ptList.toarray())
      msh.Faces.AddFaces(fcList.toarray())
      msh.VertexColors.SetColors(clrList.toarray())
      msh.Vertices.CombineIdentical(False, False)
      msh.Faces.CullDegenerateFaces()
      msh.FaceNormals.ComputeFaceNormals

      A = msh
    End If
# ---------- m_carpet: VB additional code ----------
  Function colorAverage(ByVal clrA As color, ByVal clrB As color, ByVal t As Double)
    Dim clrOut As color
    Dim R,G,B As Integer

    If CInt(clrA.r * t + clrB.r * (1 - t)) > 255 Then
      R = 255
    ElseIf CInt(clrA.r * t + clrB.r * (1 - t)) < 0 Then
      R = 0
    Else
      R = CInt(clrA.r * t + clrB.r * (1 - t))
    End If

    If CInt(clrA.g * t + clrB.g * (1 - t)) > 255 Then
      G = 255
    ElseIf CInt(clrA.g * t + clrB.g * (1 - t)) < 0 Then
      G = 0
    Else
      G = CInt(clrA.g * t + clrB.g * (1 - t))
    End If

    If CInt(clrA.b * t + clrB.b * (1 - t)) > 255 Then
      B = 255
    ElseIf CInt(clrA.b * t + clrB.b * (1 - t)) < 0 Then
      B = 0
    Else
      B = CInt(clrA.b * t + clrB.b * (1 - t))
    End If

    clrOut = color.fromargb(R, G, B)
    Return clrOut
  End Function
# ---------- end m_carpet ----------
filter_3 = StreamFilter(Gate=enable_wireframe, Stream0=gate_2.Target0, Stream1=m_carpet.A)

# ----
# The Restore State component takes the SavedStates object from the SaveStates component, a boolean value to trigger the restore, and a name of the state to restore.
restore = RestoreElementStates(Restore=restore_state_button, SavedStates=savestates.SavedStates, StateNameToRestore=pulldown_menu_value)

state_manager = Data(merge)

# ---- group: Add Elements to Window
merge_2 = Merge(Data1=_3dview, Data2=slider, Data3=stack_4, Data4=stack_6, Data5=state_manager)
addelems = AddElements(Window=launchwin, Elements=flatten(merge_2), DoVLChecking=True)  # -> AddedElements, ElementNames

# ---- group: Only pass info if different
tmatch = MatchText(Text=join, Pattern=saved_states, Case=True)
not = GateNot(A=tmatch)
dispatch = Dispatch(List=objfromgroup, DispatchPattern=not)  # -> ListA, ListB

# ----
setobj = SetObjectValue(ObjectToSet=dispatch.ListA, ValueToSet=join)

# ----
# The list of saved state names is used to populate the pulldown menu so the user can pick from among the saved states.
setlist = SetListContents(ListToModify=pulldown_menu_element, NewListContents=split)

# ---- group: Update 3d view contents
set3dview = Set3DView(_3DView=_3dview, MeshToDisplay=filter_3, MeshColors=display_color)
